# Grasshopper definition Robot_ file_ Hardware...gh (Grasshopper 1.0.7)
# plug-ins: Robots

path_1 = Curve(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)
path_1_2 = Curve(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)
path_1_3 = Curve(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)
path_1_4 = Curve(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)
crv = Curve(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)
crv_2 = Curve(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)
path_1_5 = Curve(<curve referenced from the Rhino model>)
vec = VectorXYZ(XComponent=Slider(0, range=0..500), YComponent=Slider(-400, range=-500..0), ZComponent=Slider(400, range=0..500))  # -> Vector, Length
pt = Point(Point(637.5, 6.114078133e-10, 0))
setdo = SetDO(DO="9", Value=Toggle(True))
Z = UnitZ(Factor=Slider(100, range=0..100))
move = Move(Geometry=path_1_3, Motion=Z)  # -> Geometry, Transform
end = EndPoints(Curve=move.Geometry)  # -> Start, End
end_2 = EndPoints(Curve=move.Geometry)  # -> Start, End
move_2 = Move(Geometry=path_1_5, Motion=Z)  # -> Geometry, Transform
end_3 = EndPoints(Curve=move_2.Geometry)  # -> Start, End
move_3 = Move(Geometry=path_1, Motion=Z)  # -> Geometry, Transform
end_4 = EndPoints(Curve=move_3.Geometry)  # -> Start, End
end_5 = EndPoints(Curve=move_3.Geometry)  # -> Start, End
move_4 = Move(Geometry=crv, Motion=Z)  # -> Geometry, Transform
end_6 = EndPoints(Curve=move_4.Geometry)  # -> Start, End
end_7 = EndPoints(Curve=move_4.Geometry)  # -> Start, End
move_5 = Move(Geometry=path_1_4, Motion=Z)  # -> Geometry, Transform
end_8 = EndPoints(Curve=move_5.Geometry)  # -> Start, End
end_9 = EndPoints(Curve=move_5.Geometry)  # -> Start, End
move_6 = Move(Geometry=crv_2, Motion=Z)  # -> Geometry, Transform
end_10 = EndPoints(Curve=move_6.Geometry)  # -> Start, End
move_7 = Move(Geometry=path_1_2, Motion=Z)  # -> Geometry, Transform
end_11 = EndPoints(Curve=move_7.Geometry)  # -> Start, End
end_12 = EndPoints(Curve=move_7.Geometry)  # -> Start, End
setdo_2 = SetDO(DO="9", Value=Toggle(True))
setdo_3 = SetDO(DO="9", Value=Toggle(True))
end_13 = EndPoints(Curve=move_6.Geometry)  # -> Start, End
setdo_4 = SetDO(DO="9", Value=Toggle(True))
setdo_5 = SetDO(DO="9", Value=Toggle(True))
setdo_6 = SetDO(DO="9", Value=Toggle(True))
merge = Merge(Data1=end_10.Start, Data2=end.Start)
merge_2 = Merge(Data1=end_6.Start, Data2=end_11.Start)
merge_3 = Merge(Data1=end_12.Start, Data2=end_5.Start)
merge_4 = Merge(Data1=end_2.Start, Data2=end_8.Start)
merge_5 = Merge(Data1=end_4.Start, Data2=end_3.Start)
merge_6 = Merge(Data1=end_9.Start, Data2=end_7.Start)
setdo_7 = SetDO(DO="9", Value=Toggle(True))
move_8 = Move(Geometry=pt, Motion=vec.Vector)  # -> Geometry, Transform
cp = ControlPoints(Curve=move_6.Geometry)  # -> Points, Weights, Knots
pt_2 = Point(end_13.Start)
setdo_8 = SetDO(DO="9", Value=Toggle(True))
cp_2 = ControlPoints(Curve=move_2.Geometry)  # -> Points, Weights, Knots
cp_3 = ControlPoints(Curve=move_3.Geometry)  # -> Points, Weights, Knots
cp_4 = ControlPoints(Curve=move_4.Geometry)  # -> Points, Weights, Knots
setdo_9 = SetDO(DO="9", Value=Toggle(False))
setdo_10 = SetDO(DO="9", Value=Toggle(False))
cp_5 = ControlPoints(Curve=move_5.Geometry)  # -> Points, Weights, Knots
pt_3 = Point(Point(-2.102069629e-09, 157.5, 66))
cp_6 = ControlPoints(Curve=move.Geometry)  # -> Points, Weights, Knots
cp_7 = ControlPoints(Curve=move_7.Geometry)  # -> Points, Weights, Knots
pt_4 = Point(merge)
pt_5 = Point(merge_2)
setdo_11 = SetDO(DO="9", Value=Toggle(False))
setdo_12 = SetDO(DO="9", Value=Toggle(False))
pt_6 = Point(merge_3)
pt_7 = Point(merge_4)
setdo_13 = SetDO(DO="9", Value=Toggle(False))
pt_8 = Point(merge_5)
pt_9 = Point(merge_6)
xy = XYPlane(Origin=pt_3)
pln = Plane(move_8.Geometry)
pln_2 = Plane(pt_2)
pln_3 = Plane(pt_4)
pln_4 = Plane(pt_5)
pln_5 = Plane(pt_6)
pln_6 = Plane(pt_7)
pln_7 = Plane(pt_8)
pln_8 = Plane(pt_9)
xz = XZPlane(Origin=pt_3)
pflip = FlipPlane(Plane=cp.Points, ReverseX=False, ReverseY=False, SwapAxes=True)
pflip_2 = FlipPlane(Plane=cp_2.Points, ReverseX=False, ReverseY=False, SwapAxes=True)
pflip_3 = FlipPlane(Plane=cp_3.Points, ReverseX=False, ReverseY=False, SwapAxes=True)
pflip_4 = FlipPlane(Plane=cp_4.Points, ReverseX=False, ReverseY=False, SwapAxes=True)
pflip_5 = FlipPlane(Plane=cp_5.Points, ReverseX=False, ReverseY=False, SwapAxes=True)
pflip_6 = FlipPlane(Plane=cp_6.Points, ReverseX=False, ReverseY=False, SwapAxes=True)
pflip_7 = FlipPlane(Plane=cp_7.Points, ReverseX=False, ReverseY=False, SwapAxes=True)
pflip_8 = FlipPlane(Plane=pln, ReverseX=False, ReverseY=False, SwapAxes=True)
pflip_9 = FlipPlane(Plane=pln_2, ReverseX=False, ReverseY=False, SwapAxes=True)
pflip_10 = FlipPlane(Plane=pln_3, ReverseX=False, ReverseY=False, SwapAxes=True)
pflip_11 = FlipPlane(Plane=pln_4, ReverseX=False, ReverseY=False, SwapAxes=True)
pflip_12 = FlipPlane(Plane=pln_5, ReverseX=False, ReverseY=False, SwapAxes=True)
pflip_13 = FlipPlane(Plane=pln_6, ReverseX=False, ReverseY=False, SwapAxes=True)
pflip_14 = FlipPlane(Plane=pln_7, ReverseX=False, ReverseY=False, SwapAxes=True)
pflip_15 = FlipPlane(Plane=pln_8, ReverseX=False, ReverseY=False, SwapAxes=True)
pflip_16 = FlipPlane(Plane=xz, ReverseX=False, ReverseY=False, SwapAxes=True)
prot = RotatePlane(Plane=pflip_16, Angle=degrees(Slider(460, range=0..1000)))
wait = Wait(Time="150")
prot_2 = RotatePlane(Plane=pflip, Angle=degrees(Slider(90, range=0..100)))
prot_3 = RotatePlane(Plane=pflip_2, Angle=degrees(Slider(90, range=0..100)))
prot_4 = RotatePlane(Plane=pflip_3, Angle=degrees(Slider(90, range=0..100)))
prot_5 = RotatePlane(Plane=pflip_4, Angle=degrees(Slider(90, range=0..100)))
prot_6 = RotatePlane(Plane=pflip_5, Angle=degrees(Slider(90, range=0..100)))
prot_7 = RotatePlane(Plane=pflip_6, Angle=degrees(Slider(90, range=0..100)))
prot_8 = RotatePlane(Plane=pflip_7, Angle=degrees(Slider(90, range=0..100)))
setdo_14 = SetDO(DO="9", Value=Toggle(True))
setdo_15 = SetDO(DO="9", Value=Toggle(False))
prot_9 = RotatePlane(Plane=pflip_8, Angle=degrees(Slider(90, range=0..100)))
merge_7 = Merge(Data1=setdo_7, Data2=wait)
prot_10 = RotatePlane(Plane=pflip_9, Angle=degrees(Slider(90, range=0..100)))
prot_11 = RotatePlane(Plane=pflip_10, Angle=degrees(Slider(90, range=0..100)))
prot_12 = RotatePlane(Plane=pflip_11, Angle=degrees(Slider(90, range=0..100)))
prot_13 = RotatePlane(Plane=pflip_12, Angle=degrees(Slider(90, range=0..100)))
prot_14 = RotatePlane(Plane=pflip_13, Angle=degrees(Slider(90, range=0..100)))
prot_15 = RotatePlane(Plane=pflip_14, Angle=degrees(Slider(90, range=0..100)))
prot_16 = RotatePlane(Plane=pflip_15, Angle=degrees(Slider(90, range=0..100)))
groupcmd = GroupCommand(Commands=merge_7)
groupcmd_2 = GroupCommand(Commands=setdo_8)
list = ValueList({"Joint", "Linear"}, selected="Joint")
groupcmd_3 = GroupCommand(Commands=setdo_15)
list_2 = ValueList({"Joint", "Linear"}, selected="Joint")
list_3 = ValueList({"Joint", "Linear"}, selected="Joint")
groupcmd_4 = GroupCommand(Commands=setdo_9)
list_4 = ValueList({"Joint", "Linear"}, selected="Joint")
groupcmd_5 = GroupCommand(Commands=setdo_13)
mesh = Mesh(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)
groupcmd_6 = GroupCommand(Commands=setdo_11)
groupcmd_7 = GroupCommand(Commands=setdo_10)
list_5 = ValueList({"Joint", "Linear"}, selected="Joint")
list_6 = ValueList({"Joint", "Linear"}, selected="Joint")
list_7 = ValueList({"Joint", "Linear"}, selected="Joint")
list_8 = ValueList({"Joint", "Linear"}, selected="Joint")
groupcmd_8 = GroupCommand(Commands=setdo_12)
list_9 = ValueList({"Joint", "Linear"}, selected="Joint")
list_10 = ValueList({"Joint", "Linear"}, selected="Joint")
list_11 = ValueList({"Joint", "Linear"}, selected="Joint")
groupcmd_9 = GroupCommand(Commands=setdo_14)
list_12 = ValueList({"Joint", "Linear"}, selected="Joint")
groupcmd_10 = GroupCommand(Commands=setdo_4)
groupcmd_11 = GroupCommand(Commands=setdo)
list_13 = ValueList({"Joint", "Linear"}, selected="Joint")
groupcmd_12 = GroupCommand(Commands=setdo_2)
list_14 = ValueList({"Joint", "Linear"}, selected="Joint")
list_15 = ValueList({"Joint", "Linear"}, selected="Joint")
groupcmd_13 = GroupCommand(Commands=setdo_6)
groupcmd_14 = GroupCommand(Commands=setdo_3)
groupcmd_15 = GroupCommand(Commands=setdo_5)
tool = CreateTool(Name="heat_gun", TCP=pflip_16, Weight=0, Mesh=mesh)  # -> Tool, TCP
target = CreateTarget(Plane=prot_9, Motion=list_5, Tool=tool.Tool, Zone=Slider(2, range=0..10), Command=groupcmd, IsCartesian=True)  # disabled
target_2 = CreateTarget(
    Plane=prot_10,
    Motion=list_7,
    Tool=tool.Tool,
    Speed=Slider(100, range=0..100),
    Zone=Slider(2, range=0..10),
    Command=groupcmd_2,
    IsCartesian=True)
target_3 = CreateTarget(
    Plane=prot_2,
    Motion=list,
    Tool=tool.Tool,
    Speed=Slider(4, range=0..100),
    Zone=Slider(2, range=0..10),
    Command=groupcmd_9,
    IsCartesian=True)
target_4 = CreateTarget(
    Plane=prot_11,
    Motion=list_10,
    Tool=tool.Tool,
    Speed=Slider(100, range=0..100),
    Zone=Slider(2, range=0..10),
    Command=groupcmd_3,
    IsCartesian=True)
target_5 = CreateTarget(
    Plane=prot_12,
    Motion=list_11,
    Tool=tool.Tool,
    Speed=Slider(100, range=0..100),
    Zone=Slider(2, range=0..10),
    Command=groupcmd_4,
    IsCartesian=True)
target_6 = CreateTarget(
    Plane=prot_3,
    Motion=list_2,
    Tool=tool.Tool,
    Speed=Slider(4, range=0..100),
    Zone=Slider(2, range=0..10),
    Command=groupcmd_10,
    IsCartesian=True)
target_7 = CreateTarget(
    Plane=prot_4,
    Motion=list_3,
    Tool=tool.Tool,
    Speed=Slider(4, range=0..100),
    Zone=Slider(2, range=0..10),
    Command=groupcmd_11,
    IsCartesian=True)
target_8 = CreateTarget(
    Plane=prot_13,
    Motion=list_12,
    Tool=tool.Tool,
    Speed=Slider(100, range=0..100),
    Zone=Slider(2, range=0..10),
    Command=groupcmd_5,
    IsCartesian=True)
target_9 = CreateTarget(
    Plane=prot_5,
    Motion=list_4,
    Tool=tool.Tool,
    Speed=Slider(4, range=0..100),
    Zone=Slider(2, range=0..10),
    Command=groupcmd_12,
    IsCartesian=True)
target_10 = CreateTarget(
    Plane=prot_14,
    Motion=list_13,
    Tool=tool.Tool,
    Speed=Slider(100, range=0..100),
    Zone=Slider(2, range=0..10),
    Command=groupcmd_6,
    IsCartesian=True)
target_11 = CreateTarget(
    Plane=prot_15,
    Motion=list_14,
    Tool=tool.Tool,
    Speed=Slider(100, range=0..100),
    Zone=Slider(2, range=0..10),
    Command=groupcmd_7,
    IsCartesian=True)
target_12 = CreateTarget(
    Plane=prot_16,
    Motion=list_15,
    Tool=tool.Tool,
    Speed=Slider(100, range=0..100),
    Zone=Slider(2, range=0..10),
    Command=groupcmd_8,
    IsCartesian=True)
target_13 = CreateTarget(
    Plane=prot_6,
    Motion=list_6,
    Tool=tool.Tool,
    Speed=Slider(4, range=0..100),
    Zone=Slider(2, range=0..10),
    Command=groupcmd_13,
    IsCartesian=True)
target_14 = CreateTarget(
    Plane=prot_7,
    Motion=list_8,
    Tool=tool.Tool,
    Speed=Slider(4, range=0..100),
    Zone=Slider(2, range=0..10),
    Command=groupcmd_14,
    IsCartesian=True)
target_15 = CreateTarget(
    Plane=prot_8,
    Motion=list_9,
    Tool=tool.Tool,
    Speed=Slider(4, range=0..100),
    Zone=Slider(2, range=0..10),
    Command=groupcmd_15,
    IsCartesian=True)

setdo_16 = SetDO(DO="9", Value=Toggle(False))

list_16 = ValueList({"AA-KR60", "AA-KR30", "AA-KR60_KR30", "AARCH IRB120", "AARCH IRB6620", "AAU-Utzon-UR10", "Automata", "Bartlett-IRB120", "Bartlett-IRB1600", "Bartlett-KR6"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}, selected="iaac-IRB140")
xy_2 = XYPlane(Origin=Point(0, 0, 0))
yz = YZPlane(Origin=Point(0, 0, 0))
load_robot = LoadRobotSystem(Name=list_16, Base=xy_2)

merge_8 = Merge(
    Data1=Slider(0, range=-180..180),
    Data2=Slider(0, range=-180..180),
    Data3=Slider(0, range=-180..180),
    Data4=Slider(-90, range=-180..180),
    Data5=Slider(-90, range=-180..180),
    Data6=Slider(0, range=-180..180))
degtorad = DegreesToRadians(Degrees=merge_8, RobotSystem=load_robot, MechanicalGroup=0)
target_16 = CreateTarget(Joints=degtorad, Tool=tool.Tool, Speed=Slider(25, range=0..25), Command=setdo_16, IsCartesian=False)

entwine = Entwine(
    Branch00=target_16,
    Branch01=target,
    Branch02=target_2,
    Branch03=target_3,
    Branch04=target_4,
    Branch05=target_14,
    Branch06=target_13,
    Branch07=target_12,
    Branch08=target_9,
    Branch09=target_5,
    Branch010=target_15,
    Branch011=target_8,
    Branch012=target_7,
    Branch013=target_11,
    Branch014=target_6,
    Branch015=target_16,
    FlattenInputs=True)
program = CreateProgram(Name="abb", RobotSystem=load_robot, Targets1=flatten(entwine), StepSize=1)  # -> Program, Code, Duration, Warnings, Errors
sim = ProgramSimulation(Program=program.Program, Time=Slider(0.0555, range=0..1), Normalized=True)  # -> SystemMeshes, JointRotations, Plane, Index, Time, Program, Errors
panel = Panel(program.Code)
panel_2 = Panel(sim.Time)
trail = SimpleTrail(Program=sim.Program, Length=Slider(10000, range=0..10000), MechanicalGroup=0)  # disabled
preview = CustomPreview(Geometry=sim.SystemMeshes, Material=ColourSwatch(SwatchColor=RGB(107, 107, 107)))
